% Simulink data dictionary MotionFilter_LibraryData.sldd

busMotionFilter3DoFIn = Simulink.Bus()
  reset: boolean
  model: Bus: busMotionFilter3DoFIn_model
  stddevModel: Bus: busMotionFilter3DoFIn_stddevModel
  input: Bus: busMotionFilter3DoFIn_input
  measurement: Bus: busMotionFilter3DoFIn_measurement
  stddevMeasurement: Bus: busMotionFilter3DoFIn_stddevMeasurement

busMotionFilter3DoFIn_input = Simulink.Bus()
  timestamp: double
  XYN: double[3 1]

busMotionFilter3DoFIn_measurement = Simulink.Bus()
  timestamp: double
  positionLLA: double[3 1]
  orientationYaw: double
  velocityUVR: double[3 1]

busMotionFilter3DoFIn_model = Simulink.Bus()
  matF: double[3 12]
  matB: double[3 3]

busMotionFilter3DoFIn_stddevMeasurement = Simulink.Bus()
  positionNorthEast: double[2 1]
  orientationYaw: double
  velocityUVR: double[3 1]

busMotionFilter3DoFIn_stddevModel = Simulink.Bus()
  velocityUVR: double[3 1]
  externalXYN: double[3 1]

busMotionFilter3DoFOut = Simulink.Bus()
  valid: boolean
  timestamp: double
  motion: Bus: busMotionFilter3DoFOut_motion
  disturbance: Bus: busMotionFilter3DoFOut_disturbance

busMotionFilter3DoFOut_disturbance = Simulink.Bus()
  XYN: double[3 1]

busMotionFilter3DoFOut_motion = Simulink.Bus()
  positionLLA: double[3 1]
  orientationYaw: double
  velocityUVR: double[3 1]

structMotionFilter3DoFIn = struct(
  reset=false,
  model=struct(matF=repmat(0, 3, 12), matB=repmat(0, 3, 3)),
  stddevModel=struct(velocityUVR=[0; 0; 0], externalXYN=[0; 0; 0]),
  input=struct(timestamp=0, XYN=[0; 0; 0]),
  measurement=struct(timestamp=0, positionLLA=[0; 0; 0], orientationYaw=0, velocityUVR=[0; 0; 0]),
  stddevMeasurement=struct(positionNorthEast=[0; 0], orientationYaw=0, velocityUVR=[0; 0; 0]))

structMotionFilter3DoFOut = struct(
  valid=false,
  timestamp=0,
  motion=struct(positionLLA=[0; 0; 0], orientationYaw=0, velocityUVR=[0; 0; 0]),
  disturbance=struct(XYN=[0; 0; 0]))